# Grasshopper definition Tower formation_Active.gh (Grasshopper 0.9.76)
# plug-ins: MeshGrowth

cir = Circle(Plane=PlaneXY(0, 0, 0), Radius=Slider(8, range=0..100))
srf = Surface(cir)
mesh_uv = MeshSurface(Surface=srf, UCount=Slider(20, range=0..100), VCount=Slider(20, range=0..100), Overhang=True, Equalize=True)
timer = Timer(TimerInterval=20, Target=meshgrowthtower)  # disabled
meshgrowthtower = MeshGrowthTower(
    Mesh=mesh_uv,
    Reset=Button(),
    Grow=Toggle(True),
    FacadeVertexCount=Slider(5000, range=0..10000),
    SlabVertexCount=Slider(755, range=0..10000),
    CollisionRange=Slider(1.23, range=0..10),
    FloortoFloor=Slider(3, range=0..10),
    CeilingOffset=Slider(0.5, range=0..10),
    MaxHeight=Slider(30, range=0..100),
    VerticalWeight=Slider(1, range=0..10),
    UniformWeight=Slider(0.548, range=0..10))  # -> Mesh, Iterations
item = ListItem(Index=Slider(0, range=0..100), Wrap=True)
preview = CustomPreview(Geometry=meshgrowthtower.Mesh, Shader=ColourSwatch(SwatchColor=RGB(181, 181, 181)))
